# Grasshopper definition Arezzo_2.gh (Grasshopper 1.0.7)
# plug-ins: BH.UI.Grasshopper

curve = Curve([<curve referenced from the Rhino model> x2])  # disabled
curve_2 = Curve(<curve referenced from the Rhino model>)
curve_3 = Curve([<curve referenced from the Rhino model> x2])  # disabled

perimeterlevel = PerimeterLevel(
    {"Random": 0, "Maximum": 1, "Minimum": 2, "MaxCentre": 3, "MaxEnds": 4, "StartEnd": 5, "EndStart": 6}, selected="Maximum",
    Component="BH.oM.TSP.PerimeterLevel",
    Selection=1)
radians = Radians(Degrees=Slider(0, range=0..100))
barslayout = BarsLayout(
    PrincipleDirection=radians,
    MaximumPlacementAttempts=10,
    GapToHeightRatio=Slider(0.35, range=0..1),
    Name="BarsLayout",
    BoundaryOffset=Slider(12, range=0..15),
    Component="BH.oM.TSP.BarsLayout")
perimeterlayout = PerimeterLayout(
    PerimeterLevelMethod=perimeterlevel,
    MinimumLevel=Slider(8, range=0..10),
    Name="PerimeterLayout",
    BoundaryOffset=Slider(6, range=0..15),
    Component="BH.oM.TSP.PerimeterLayout")
hybridlayout = HybridLayout(BarsLayout=barslayout, PerimeterLayout=perimeterlayout, Name="HybridLayout", Component="BH.oM.TSP.HybridLayout")
data = Data(hybridlayout)

roadlanduse = RoadLandUse(Boundary=curve_3, Component="BH.oM.TSP.RoadLandUse")  # disabled
openlanduse = OpenLandUse(Boundary=curve, Component="BH.oM.TSP.OpenLandUse")  # disabled
sitelanduse = SiteLandUse(Boundary=curve_2, Component="BH.oM.TSP.SiteLandUse")

brep = Brep([<brep referenced from the Rhino model> x61])
mesh_brep = MeshBrep(
    Brep=brep,
    Settings={GridMaxCount=0, GridMinCount=16, JaggedSeams=False, MaxEdgeLength=0, MinEdgeLength=0.0001, MinTolerance=0, Refine=True, RefineAngle=0, RelativeTolerance=0.65, SimplePlanes=True, Tolerance=0})
facilitiesparameters = FacilitiesParameters(
    ParkingSpacesPerApartment=Slider(0.75, range=0..1),
    RowDepth=15,
    NumberOfRows=Slider(1, range=0..10),
    TargetStories=5,
    CommercialAreaAsPercentOfTotalApartmentsArea=5,
    CommunalAreaAsPercentOfTotalApartmentsArea=5,
    MinimumLength=40,
    FloorToFloor=4.5,
    BaseOffset=4.5,
    Component="BH.oM.TSP.FacilitiesParameters")
data_2 = Data(flatten([roadlanduse, sitelanduse, openlanduse]))
sunpoints = Point([Point(183.8904745, -72.22846052, 31.1021364), Point(139.4467078, -82.7251619, 117.0946765), Point(57.63755966, -89.10087237, 169.5256507), Point(-39.63087437, -89.63032764, 174.3439077), Point(-126.3060269, -84.15390303, 130.2494076), Point(-179.1668116, -74.12075113, 49.04454984)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])
costparameters = CostParameters(
    HousingMetreSquared=1,
    ParkingMetreSquared=1,
    CommercialMetreSquared=1,
    GreenAreaMetreSquared=1,
    InternalCirculationMetreSquared=1,
    ExternalCirculationMetreSquared=1,
    Component="BH.oM.TSP.CostParameters")
unit = Unit(
    X=Slider(10, range=0..10),
    Y=Slider(27, range=0..100),
    Z=3.5,
    CoordinateSystem="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",
    NumberOfApartments=Slider(4, range=0..10),
    ApartmentArea=65,
    CirculationArea=4,
    Component="BH.oM.TSP.Unit")
planparameters = PlanParameters(
    MinimumUnits=1,
    MaximumUnits=10,
    MinimumUnitsSpace=2,
    LandUses=data_2,
    FootprintOffset=Slider(1.2, range=0..10),
    Component="BH.oM.TSP.PlanParameters")
verticalparameters = VerticalParameters(MaximumLevel=Slider(12, range=0..100), Component="BH.oM.TSP.VerticalParameters")
solaraccessparameters = SolarAccessParameters(SunPoints=sunpoints, Obstructions=mesh_brep, Run=Toggle(True), Component="BH.oM.TSP.SolarAccessParameters")

facilitieslanduse = FacilitiesLandUse(Layout=data, Parameters=facilitiesparameters, SiteLand=sitelanduse, Component="{ .FacilitiesLandUse")
number_slider = Slider(1, range=0..1)
parameters = Parameters(
    PrototypeUnit=unit,
    PlanParameters=planparameters,
    VerticalParameters=verticalparameters,
    FacilitiesParameters=facilitiesparameters,
    SolarAccessParameters=solaraccessparameters,
    CostParameters=costparameters,
    LayoutMethod=data,
    Name="Default",
    Component="BH.oM.TSP.Parameters")
explode = Explode(Object=facilitieslanduse, Component="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")  # -> Boundary, Name, CoordinateSystem, BHoM_Guid, Fragments, Tags, CustomData
facilitiesblock = FacilitiesBlock(Component="{ .FacilitiesBlock")
solution = Solution(Parameters=parameters, Run=Toggle(True), MaxIterations=10, Component="{ .Solution")
curve_4 = Curve(explode.Boundary)

use = Use(
    {"Apartment": 0, "Commercial": 1, "Parking": 2, "Communal": 3, "Circulation": 4, "Site": 5, "Open": 6}, selected="Apartment",
    Component="BH.oM.TSP.Use",
    Selection=0)
use_2 = Use(
    {"Apartment": 0, "Commercial": 1, "Parking": 2, "Communal": 3, "Circulation": 4, "Site": 5, "Open": 6}, selected="Commercial",
    Component="BH.oM.TSP.Use",
    Selection=1)
use_3 = Use(
    {"Apartment": 0, "Commercial": 1, "Parking": 2, "Communal": 3, "Circulation": 4, "Site": 5, "Open": 6}, selected="Parking",
    Component="BH.oM.TSP.Use",
    Selection=2)
previewcolourmap = PreviewColourMap(
    Uses=[use, use_2, use_3],
    Colours=[ColourSwatch(SwatchColor=RGBA(55, 150, 188, 196)), ColourSwatch(SwatchColor=RGBA(0, 255, 21, 167)), ColourSwatch(SwatchColor=RGB(126, 129, 132))],
    Component="{ .PreviewColourMap")

panel = Panel("""0
1""")
number = Number(panel)
gradient = Gradient(
    Colors=[ColourSwatch(SwatchColor=RGB(0, 152, 0)), ColourSwatch(SwatchColor=RGB(255, 255, 0))],
    Positions=number,
    Component="{ .Gradient")

explode_2 = Explode(Object=solution, Component="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")  # -> ObjectId, ResultCase, TimeStep, Development, SolarResults, UseSummary
explode_3 = Explode(Object=explode_2.Development, Component="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")  # -> Bars, Field, FacilitiesBlock, BHoM_Guid, Name, Fragments, Tags, CustomData
explode_4 = Explode(Object=explode_2.UseSummary, Component="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")  # -> PlotArea, NetPlotArea, UsedArea, Occupation, InternalCirculation, ExternalCirculation, TotalCirculation, HousingUnitsNumber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
preview = Preview(Result=solution, Minimum=Slider(0, range=0..1), Maximum=Slider(12, range=0..100), Component="{ .Preview")
